# Grasshopper definition path.gh (Grasshopper 1.0.7)

# ----
# Change the number of layer with boolean
# in the dispatch pattern
# D=2cm
# D=4.5cm
surface = Surface(<surface referenced from the Rhino model>)
# Uroko (3 different layers with 3 different number of layers)
# 3
surface_2 = Surface(<surface referenced from the Rhino model>)
brep = Brep(<brep referenced from the Rhino model>)
contour = Contour(Shape=surface, Point=Point(0, 0, 0), Direction=Vector(0, 0, 1), Distance=Slider(0.65, range=0..1))
dispatch = Dispatch(List=flatten(contour), DispatchPattern=[False, False, True, False, False, True])  # -> ListA, ListB
dispatch_2 = Dispatch(List=dispatch.ListA, DispatchPattern=[True, False])  # -> ListA, ListB
divide_curve = DivideCurve(Curve=dispatch_2.ListA, Count=Slider(20, range=0..100), Kinks=False)  # -> Points, Tangents, Parameters
divide_curve_2 = DivideCurve(Curve=dispatch_2.ListB, Count=Slider(20, range=0..100), Kinks=False)  # -> Points, Tangents, Parameters
number_slider = Slider(3, range=0..10)
divide_curve_3 = DivideCurve(Curve=dispatch.ListB, Count=Slider(50, range=0..100), Kinks=False)  # -> Points, Tangents, Parameters
number_slider_2 = Slider(30, range=0..100)
dispatch_3 = Dispatch(List=divide_curve.Points, DispatchPattern=[True, False])  # -> ListA, ListB
brep_closest_point = BrepClosestPoint(Point=dispatch_3.ListB, Brep=surface)  # -> Point, Normal, Distance
dispatch_4 = Dispatch(List=divide_curve_2.Points, DispatchPattern=[False, True])  # -> ListA, ListB
number_slider_3 = Slider(3, range=0..10)
number_slider_4 = Slider(30, range=0..100)
amplitude = Amplitude(Vector=brep_closest_point.Normal, Amplitude=Slider(2.5, range=0..10))
polyline = PolyLine(Vertices=divide_curve_3.Points, Closed=True)
brep_closest_point_2 = BrepClosestPoint(Point=dispatch_4.ListB, Brep=surface)  # -> Point, Normal, Distance
panel = Panel(dispatch_3.ListA)
move = Move(Geometry=dispatch_3.ListB, Motion=amplitude)  # -> Geometry, Transform
amplitude_2 = Amplitude(Vector=brep_closest_point_2.Normal, Amplitude=Slider(3.5, range=0..10))
panel_2 = Panel(dispatch_3.ListB)
weave = Weave(Pattern=[0, 1], Stream0=dispatch_3.ListA, Stream1=move.Geometry, NullGaps=False)
move_2 = Move(Geometry=dispatch_4.ListB, Motion=amplitude_2)  # -> Geometry, Transform
vector_display_ex = VectorDisplayEx(Point=brep_closest_point_2.Point, Vector=amplitude_2, Colour=RGB(0, 0, 0), Width=2)
polyline_2 = PolyLine(Vertices=weave, Closed=True)
weave_2 = Weave(Pattern=[1, 0], Stream0=dispatch_4.ListA, Stream1=move_2.Geometry, NullGaps=False)
panel_3 = Panel(polyline_2)
polyline_3 = PolyLine(Vertices=weave_2, Closed=True)
weave_3 = Weave(
    Pattern=[0, 0, 1, 0, 0, 2],
    Stream0=flatten(polyline),
    Stream1=flatten(polyline_2),
    Stream2=flatten(polyline_3),
    NullGaps=False)  # -> graft(Weave)
panel_4 = Panel(weave_3)

# ----
# 2
# Alternate layers（網目）
surface_3 = Surface(<surface referenced from the Rhino model>)
number_slider_5 = Slider(0.7, range=0..10)
contour_2 = Contour(Shape=surface_3, Point=Point(0, 0, 0), Direction=Vector(0, 0, 1), Distance=Slider(0.65, range=0..1))
dispatch_5 = Dispatch(List=flatten(contour_2), DispatchPattern=[True, False])  # -> ListA, ListB
panel_5 = Panel(dispatch_5.ListB)
panel_7 = Panel("""0
0
1""")
panel_8 = Panel(dispatch_5.ListA)
divide_curve_4 = DivideCurve(Curve=dispatch_5.ListB, Count=Slider(30, range=0..100), Kinks=False)  # -> Points, Tangents, Parameters
number_slider_6 = Slider(47, range=0..100)
dispatch_6 = Dispatch(List=divide_curve_4.Points, DispatchPattern=[True, False])  # -> ListA, ListB
divide_curve_5 = DivideCurve(Curve=dispatch_5.ListA, Count=Slider(30, range=0..100), Kinks=False)  # -> Points, Tangents, Parameters
number_slider_7 = Slider(30, range=0..100)
brep_closest_point_3 = BrepClosestPoint(Point=dispatch_6.ListB, Brep=surface_3)  # -> Point, Normal, Distance
dispatch_7 = Dispatch(List=divide_curve_5.Points, DispatchPattern=[False, True])  # -> ListA, ListB
number_slider_8 = Slider(3, range=0..10)
number_slider_9 = Slider(30, range=0..100)
amplitude_3 = Amplitude(Vector=brep_closest_point_3.Normal, Amplitude=Slider(4, range=0..10))
panel_9 = Panel(brep_closest_point_3.Normal)
brep_closest_point_4 = BrepClosestPoint(Point=dispatch_7.ListB, Brep=surface_3)  # -> Point, Normal, Distance
panel_10 = Panel(dispatch_6.ListA)
brep_closest_point_5 = BrepClosestPoint(Point=dispatch_7.ListA)  # -> Point, Normal, Distance
panel_11 = Panel(brep_closest_point_4.Normal)
move_3 = Move(Geometry=dispatch_6.ListB, Motion=amplitude_3)  # -> Geometry, Transform
amplitude_4 = Amplitude(Vector=brep_closest_point_4.Normal, Amplitude=Slider(7, range=0..10))
panel_12 = Panel(dispatch_6.ListB)
panel_13 = Panel(dispatch_7.ListA)
panel_14 = Panel(dispatch_7.ListB)
weave_4 = Weave(Pattern=[0, 1], Stream0=dispatch_6.ListA, Stream1=move_3.Geometry, NullGaps=False)
panel_15 = Panel(move_3.Geometry)
move_4 = Move(Geometry=dispatch_7.ListB, Motion=amplitude_4)  # -> Geometry, Transform
vector_display_ex_2 = VectorDisplayEx(Point=brep_closest_point_4.Point, Vector=amplitude_4, Colour=RGB(0, 0, 0), Width=2)
polyline_4 = PolyLine(Vertices=weave_4, Closed=True)
panel_16 = Panel(weave_4)
# Change the pattern according to the number of layers
weave_5 = Weave(Pattern=[1, 0], Stream0=dispatch_7.ListA, Stream1=move_4.Geometry, NullGaps=False)
panel_17 = Panel(move_4.Geometry)
polyline_5 = PolyLine(Vertices=weave_5, Closed=True)
panel_18 = Panel(polyline_5)
weave_6 = Weave(Pattern=[0, 1], Stream0=flatten(polyline_5), Stream1=flatten(polyline_4), NullGaps=False)  # -> graft(Weave)
panel_19 = Panel(weave_6)

# ----
# 1
# たらしとトゲトゲ
brep_2 = Brep(<brep referenced from the Rhino model>)
surface_4 = Surface(<surface referenced from the Rhino model>)
# Change the number of layer with boolean
# in the dispatch pattern
contour_3 = Contour(Shape=brep_2, Point=Point(0, 0, 0), Direction=Vector(0, 0, 1), Distance=Slider(0.65, range=0..1))
dispatch_8 = Dispatch(List=flatten(contour_3), DispatchPattern=[True, True, True, False])  # -> ListA, ListB
panel_20 = Panel(dispatch_8.ListB)
divide_curve_6 = DivideCurve(Curve=dispatch_8.ListB, Count=Slider(53, range=0..100), Kinks=False)  # -> Points, Tangents, Parameters
panel_21 = Panel(dispatch_8.ListA)
divide_curve_7 = DivideCurve(Curve=dispatch_8.ListA, Count=Slider(44, range=0..100), Kinks=False)  # -> Points, Tangents, Parameters
dispatch_9 = Dispatch(List=divide_curve_6.Points, DispatchPattern=[True, False])  # -> ListA, ListB
polyline_6 = PolyLine(Vertices=divide_curve_7.Points, Closed=True)
brep_closest_point_6 = BrepClosestPoint(Point=dispatch_9.ListB, Brep=brep_2)  # -> Point, Normal, Distance
amplitude_5 = Amplitude(Vector=brep_closest_point_6.Normal, Amplitude=Slider(2, range=0..10))
panel_22 = Panel(dispatch_9.ListA)
panel_23 = Panel(dispatch_9.ListB)
move_5 = Move(Geometry=dispatch_9.ListB, Motion=amplitude_5)  # -> Geometry, Transform
weave_7 = Weave(Pattern=[0, 1], Stream0=dispatch_9.ListA, Stream1=move_5.Geometry, NullGaps=False)
polyline_7 = PolyLine(Vertices=weave_7, Closed=True)
weave_8 = Weave(Pattern=[0, 0, 0, 1], Stream0=flatten(polyline_6), Stream1=flatten(polyline_7), NullGaps=False)  # -> graft(Weave)
panel_24 = Panel(weave_8)

# ----
# to g-code
explode = Explode(Curve=weave_3, Recursive=True)  # -> Segments, Vertices
control_points = ControlPoints(Curve=weave_3)  # -> Points, Weights, Knots
number_slider_10 = Slider(0, range=0..100)
panel_25 = Panel(explode.Segments)
number_slider_11 = Slider(0.005, range=0..0.01)
number_slider_12 = Slider(0.0075, range=0..0.01)
panel_26 = Panel(control_points.Points)
number_slider_13 = Slider(0.013, range=0..0.1)
length = Length(Curve=explode.Segments)
insert_items = InsertItems(List=flatten(length), Item=number_slider_10, Indices=number_slider_10, Wrap=True)
number_slider_14 = Slider(0.015, range=0..0.1)
number_slider_15 = Slider(0.02, range=0..0.1)
deconstruct = Deconstruct(Point=flatten(panel_26))  # -> XComponent, YComponent, ZComponent
multiplication = Multiplication(A=insert_items, B=Slider(0.01, range=0..0.01))
number_slider_16 = Slider(0.015, range=0..0.1)
mass_addition = MassAddition(Input=flatten(multiplication))  # -> Result, PartialResults
panel_27 = Panel(multiplication)
multiplication_2 = Multiplication(A=Slider(30, range=0..100), B=Slider(60, range=0..100))
panel_28 = Panel(mass_addition.PartialResults)
concatenate = Concatenate(
    FragmentH="G1 ",
    FragmentG="F",
    FragmentK=multiplication_2,
    FragmentA=" X",
    FragmentB=deconstruct.XComponent,
    FragmentC=" Y",
    FragmentD=deconstruct.YComponent,
    FragmentE=" Z",
    FragmentF=deconstruct.ZComponent,
    FragmentI=" E",
    FragmentJ=panel_28)
panel_29 = Panel(concatenate)
panel_30 = Panel("""G90 
M82
G28
G92 E0.0000
G1 E-4.0000 F6000""")
panel_31 = Panel("""G92 E0.0000
G1 Z30 E-4.0000 F6000
G28""")
merge = Merge(Data1=flatten(panel_30), Data2=flatten(concatenate), Data3=flatten(panel_31))
panel_32 = Panel(merge)
