# Grasshopper definition path_grashopper.gh (Grasshopper 1.0.7)

brep = Brep(<brep referenced from the Rhino model>)
# 2
surface = Surface(<surface referenced from the Rhino model>)
number_slider = Slider(1, range=0..1)
# Curve order
layer_height = Slider(1, range=0..10)
xz_plane = XZPlane(Origin=Point(0, 0, 0))
# Example 3: complex contour using multiple curves
curve = Curve([<curve referenced from the Rhino model> x3])
# Display curve
geometry_pipeline = GeometryPipeline(
    GroupByLayer=False,
    GroupByType=False,
    IncludeHidden=True,
    IncludeLocked=True,
    LayerFilter="*",
    NameFilter="*",
    SublayerFiltering=True,
    TypeFilter=0)
# Example 1: straight z line curves
brep_2 = Brep(<brep referenced from the Rhino model>)
# Example 2: curvy z line
brep_3 = Brep(<brep referenced from the Rhino model>)
# Style
loft_options = LoftOptions(Closed=False, Adjust=False, Rebuild=0, Refit=0, Type=0)
# Seam
geometry_pipeline_2 = GeometryPipeline(
    GroupByLayer=False,
    GroupByType=False,
    IncludeHidden=True,
    IncludeLocked=True,
    LayerFilter="*",
    NameFilter="*",
    SublayerFiltering=True,
    TypeFilter=0)
geometry = Geometry(<brep referenced from the Rhino model>)
# layer height
# ramp
# 1mm height divided by 5 ramp, the first point will move 0.2mm, the next 0.4mm until 1mm.
number_slider_2 = Slider(5, range=0..10)
# number of points
number_slider_3 = Slider(50, range=0..100)
# Curve direction
geometry_pipeline_3 = GeometryPipeline(
    GroupByLayer=False,
    GroupByType=False,
    IncludeHidden=True,
    IncludeLocked=True,
    LayerFilter="*",
    NameFilter="*",
    SublayerFiltering=True,
    TypeFilter=0)
geometry_pipeline_4 = GeometryPipeline(
    GroupByLayer=False,
    GroupByType=False,
    IncludeHidden=True,
    IncludeLocked=True,
    LayerFilter="*",
    NameFilter="*",
    SublayerFiltering=True,
    TypeFilter=0)
# “Rebuild” to make 16 points
curve_2 = Curve([<curve referenced from the Rhino model> x7])
loft = Loft(Curves=curve, Options={Adjust=False, Closed=False, LoftEnds=0, LoftSimp=0, LoftType=0, Rebuild=10, Refit=0.01})
contour = Contour(Shape=brep_2, Point=Point(0, 0, 0), Direction=Vector(0, 0, 1), Distance=number_slider)
number_slider_4 = Slider(50, range=0..100)
curve_plane = CurvePlane(Curve=curve_2, Plane=xz_plane)  # -> Points, ParamsC, ParamsP
contour_2 = Contour(Shape=brep_3, Point=Point(0, 0, 0), Direction=Vector(0, 0, 1), Distance=Slider(1, range=0..1))
bounding_box = BoundingBox(Content=geometry, Plane=PlaneXY(0, 0, 0))  # -> Box, Box_2
point = Point()

# ----
# Change the number of layer with boolean
# in the dispatch pattern
# D=2cm
# D=4.5cm
surface_2 = Surface(<surface referenced from the Rhino model>)
# Uroko (3 different layers with 3 different number of layers)
# 3
surface_3 = Surface(<surface referenced from the Rhino model>)
brep_4 = Brep(<brep referenced from the Rhino model>)
contour_3 = Contour(Shape=surface_2, Point=Point(0, 0, 0), Direction=Vector(0, 0, 1), Distance=Slider(0.65, range=0..1))
dispatch = Dispatch(List=flatten(contour_3), DispatchPattern=[False, False, True, False, False, True])  # -> ListA, ListB
dispatch_2 = Dispatch(List=dispatch.ListA, DispatchPattern=[True, False])  # -> ListA, ListB
divide_curve = DivideCurve(Curve=dispatch_2.ListA, Count=Slider(20, range=0..100), Kinks=False)  # -> Points, Tangents, Parameters
divide_curve_2 = DivideCurve(Curve=dispatch_2.ListB, Count=Slider(20, range=0..100), Kinks=False)  # -> Points, Tangents, Parameters
number_slider_5 = Slider(3, range=0..10)
divide_curve_3 = DivideCurve(Curve=dispatch.ListB, Count=Slider(50, range=0..100), Kinks=False)  # -> Points, Tangents, Parameters
number_slider_6 = Slider(30, range=0..100)
dispatch_3 = Dispatch(List=divide_curve.Points, DispatchPattern=[True, False])  # -> ListA, ListB
brep_closest_point = BrepClosestPoint(Point=dispatch_3.ListB, Brep=surface_2)  # -> Point, Normal, Distance
dispatch_4 = Dispatch(List=divide_curve_2.Points, DispatchPattern=[False, True])  # -> ListA, ListB
number_slider_7 = Slider(3, range=0..10)
number_slider_8 = Slider(30, range=0..100)
amplitude = Amplitude(Vector=brep_closest_point.Normal, Amplitude=Slider(2.5, range=0..10))
polyline = PolyLine(Vertices=divide_curve_3.Points, Closed=True)
brep_closest_point_2 = BrepClosestPoint(Point=dispatch_4.ListB, Brep=surface_2)  # -> Point, Normal, Distance
panel = Panel(dispatch_3.ListA)
move = Move(Geometry=dispatch_3.ListB, Motion=amplitude)  # -> Geometry, Transform
amplitude_2 = Amplitude(Vector=brep_closest_point_2.Normal, Amplitude=Slider(3.5, range=0..10))
panel_2 = Panel(dispatch_3.ListB)
weave = Weave(Pattern=[0, 1], Stream0=dispatch_3.ListA, Stream1=move.Geometry, NullGaps=False)
move_2 = Move(Geometry=dispatch_4.ListB, Motion=amplitude_2)  # -> Geometry, Transform
vector_display_ex = VectorDisplayEx(Point=brep_closest_point_2.Point, Vector=amplitude_2, Colour=RGB(0, 0, 0), Width=2)
polyline_2 = PolyLine(Vertices=weave, Closed=True)
weave_2 = Weave(Pattern=[1, 0], Stream0=dispatch_4.ListA, Stream1=move_2.Geometry, NullGaps=False)
panel_3 = Panel(polyline_2)
polyline_3 = PolyLine(Vertices=weave_2, Closed=True)
weave_3 = Weave(
    Pattern=[0, 0, 1, 0, 0, 2],
    Stream0=flatten(polyline),
    Stream1=flatten(polyline_2),
    Stream2=flatten(polyline_3),
    NullGaps=False)  # -> graft(Weave)
panel_4 = Panel(weave_3)

contour_4 = Contour(Shape=loft, Point=Point(0, 0, 0), Direction=Vector(0, 0, 1), Distance=layer_height)
loft_2 = Loft(Options=loft_options)
curve_closest_point = CurveClosestPoint(Point=point, Curve=geometry_pipeline_2)  # -> Point, Parameter, Distance
point_on_curve = PointOnCurve(geometry_pipeline_4, parameter=0.5)
divide_curve_4 = DivideCurve(Curve=contour, Count=number_slider_3, Kinks=False)  # -> Points, Tangents, Parameters
list_item = ListItem(List=geometry_pipeline_3, Index=0, Wrap=True)
deconstruct_box = DeconstructBox(Box=bounding_box.Box)  # -> Plane, X, Y, Z
division = Division(A=number_slider, B=number_slider_2)
deconstruct = Deconstruct(Point=curve_plane.Points)  # -> XComponent, YComponent, ZComponent
point_2 = Point()
point_3 = Point()

# ----
# Alternate layers（網目）
surface_4 = Surface(<surface referenced from the Rhino model>)
number_slider_9 = Slider(0.7, range=0..10)
contour_5 = Contour(Shape=surface_4, Point=Point(0, 0, 0), Direction=Vector(0, 0, 1), Distance=Slider(0.65, range=0..1))
dispatch_5 = Dispatch(List=flatten(contour_5), DispatchPattern=[True, False])  # -> ListA, ListB
panel_5 = Panel(dispatch_5.ListB)
panel_7 = Panel("""0
0
1""")
panel_8 = Panel(dispatch_5.ListA)
divide_curve_5 = DivideCurve(Curve=dispatch_5.ListB, Count=Slider(30, range=0..100), Kinks=False)  # -> Points, Tangents, Parameters
number_slider_10 = Slider(47, range=0..100)
dispatch_6 = Dispatch(List=divide_curve_5.Points, DispatchPattern=[True, False])  # -> ListA, ListB
divide_curve_6 = DivideCurve(Curve=dispatch_5.ListA, Count=Slider(30, range=0..100), Kinks=False)  # -> Points, Tangents, Parameters
number_slider_11 = Slider(30, range=0..100)
brep_closest_point_3 = BrepClosestPoint(Point=dispatch_6.ListB, Brep=surface_4)  # -> Point, Normal, Distance
dispatch_7 = Dispatch(List=divide_curve_6.Points, DispatchPattern=[False, True])  # -> ListA, ListB
number_slider_12 = Slider(3, range=0..10)
number_slider_13 = Slider(30, range=0..100)
amplitude_3 = Amplitude(Vector=brep_closest_point_3.Normal, Amplitude=Slider(4, range=0..10))
panel_9 = Panel(brep_closest_point_3.Normal)
brep_closest_point_4 = BrepClosestPoint(Point=dispatch_7.ListB, Brep=surface_4)  # -> Point, Normal, Distance
panel_10 = Panel(dispatch_6.ListA)
brep_closest_point_5 = BrepClosestPoint(Point=dispatch_7.ListA)  # -> Point, Normal, Distance
panel_11 = Panel(brep_closest_point_4.Normal)
move_3 = Move(Geometry=dispatch_6.ListB, Motion=amplitude_3)  # -> Geometry, Transform
amplitude_4 = Amplitude(Vector=brep_closest_point_4.Normal, Amplitude=Slider(7, range=0..10))
panel_12 = Panel(dispatch_6.ListB)
panel_13 = Panel(dispatch_7.ListA)
panel_14 = Panel(dispatch_7.ListB)
weave_4 = Weave(Pattern=[0, 1], Stream0=dispatch_6.ListA, Stream1=move_3.Geometry, NullGaps=False)
panel_15 = Panel(move_3.Geometry)
move_4 = Move(Geometry=dispatch_7.ListB, Motion=amplitude_4)  # -> Geometry, Transform
vector_display_ex_2 = VectorDisplayEx(Point=brep_closest_point_4.Point, Vector=amplitude_4, Colour=RGB(0, 0, 0), Width=2)
polyline_4 = PolyLine(Vertices=weave_4, Closed=True)
panel_16 = Panel(weave_4)
# Change the pattern according to the number of layers
weave_5 = Weave(Pattern=[1, 0], Stream0=dispatch_7.ListA, Stream1=move_4.Geometry, NullGaps=False)
panel_17 = Panel(move_4.Geometry)
polyline_5 = PolyLine(Vertices=weave_5, Closed=True)
panel_18 = Panel(polyline_5)
weave_6 = Weave(Pattern=[0, 1], Stream0=flatten(polyline_5), Stream1=flatten(polyline_4), NullGaps=False)  # -> graft(Weave)
panel_19 = Panel(weave_6)

subtraction = Subtraction(A=number_slider_3, B=number_slider_2)
divide_curve_7 = DivideCurve(Curve=contour_2, Count=number_slider_4, Kinks=False)  # -> Points, Tangents, Parameters
surface_5 = Surface(<surface referenced from the Rhino model>)
control_points = ControlPoints(Curve=contour_4)  # -> Points, Weights, Knots
# Weave makes better line paths
number_slider_14 = Slider(1.1, range=0..10)
evaluate_curve = EvaluateCurve(Curve=reparameterize(geometry_pipeline), Parameter=Slider(0.5, range=0..1))  # -> Point, Tangent, Angle
seam = Seam(Curve=geometry_pipeline_2, Seam=curve_closest_point.Parameter)
brep_5 = Brep(<brep referenced from the Rhino model>)
flip_curve = FlipCurve(Curve=geometry_pipeline_3, Guide=list_item)  # -> Curve, Flag
series = Series(Start=0, Step=division, Count=number_slider_2)
deconstruct_domain = DeconstructDomain(Domain=deconstruct_box.Z)  # -> Start, End
closest_point = ClosestPoint(Point=point_3, Cloud=point_2)  # -> ClosestPoint, CPIndex, Distance
deconstruct_2 = Deconstruct(Point=point_on_curve)  # -> XComponent, YComponent, ZComponent
sort_list = SortList(Keys=deconstruct.XComponent, ValuesB=curve_plane.Points, ValuesValuesA=curve_plane.ParamsC)  # -> Keys, ValuesB, ValuesValuesA
flip_matrix = FlipMatrix(Data=divide_curve_7.Points)
split_list = SplitList(List=divide_curve_4.Points, Index=subtraction)  # -> ListA, ListB
point_4 = Point()
curve_3 = Curve()
cull_index = CullIndex(List=control_points.Points, Indices=Slider(0, range=0..100), Wrap=True)
loft_3 = Loft(Curves=seam, Options={Adjust=False, Closed=False, LoftEnds=0, LoftSimp=0, LoftType=0, Rebuild=10, Refit=0.01})
loft_4 = Loft(
    Curves=flip_curve.Curve,
    Options={Adjust=False, Closed=False, LoftEnds=0, LoftSimp=0, LoftType=0, Rebuild=10, Refit=0.01})
unit_z = UnitZ(Factor=series)
vector_display = VectorDisplay(Anchor=evaluate_curve.Point, Vector=evaluate_curve.Tangent)
division_2 = Division(A=deconstruct_domain.End)
polyline_6 = PolyLine(Vertices=flip_matrix, Closed=False)
sort_list_2 = SortList(Keys=deconstruct_2.ZComponent, ValuesValuesA=geometry_pipeline_4)  # -> Keys, ValuesValuesA
bounds = Bounds(Numbers=closest_point.Distance)
curve_closest_point_2 = CurveClosestPoint(Point=point_4, Curve=curve_3)  # -> Point, Parameter, Distance
# Change the number of layer with boolean
# in the dispatch pattern
contour_6 = Contour(Shape=surface_5, Point=Point(0, 0, 0), Direction=Vector(0, 0, 1), Distance=Slider(0.65, range=0..1))
list_item_2 = ListItem(List=sort_list.ValuesValuesA, Index=0, Wrap=True)
seam_2 = Seam(Curve=curve_2, Seam=flatten(list_item_2))
flip_matrix_2 = FlipMatrix(Data=cull_index)
list_length = ListLength(List=cull_index)
move_5 = Move(Geometry=split_list.ListB, Motion=unit_z)  # -> Geometry, Transform
range = Range(Domain=Domain(0, 1), Steps=division_2)
# 5 points : 5 - 1 =4 because if 6-1 = 5, have undesirable effect
explode = Explode(Curve=polyline_6, Recursive=True)  # -> Segments, Vertices
polyline_7 = PolyLine(Vertices=flip_matrix_2, Closed=False)
bounds_2 = Bounds(Numbers=curve_closest_point_2.Distance)
remap_numbers = RemapNumbers(Value=closest_point.Distance, Source=bounds, Target="(0 to 3)")  # -> Mapped, Clipped
dispatch_8 = Dispatch(List=flatten(contour_6), DispatchPattern=[True, True, True, False])  # -> ListA, ListB
loft_5 = Loft(
    Curves=sort_list_2.ValuesValuesA,
    Options={Adjust=False, Closed=False, LoftEnds=0, LoftSimp=0, LoftType=0, Rebuild=10, Refit=0.01})
panel_20 = Panel(seam_2)
loft_6 = Loft(Curves=seam_2, Options={Adjust=False, Closed=False, LoftEnds=0, LoftSimp=0, LoftType=0, Rebuild=10, Refit=0.01})
merge = Merge(Data1=split_list.ListA, Data2=move_5.Geometry)

# ----
# 1
# たらしとトゲトゲ
brep_6 = Brep(<brep referenced from the Rhino model>)
surface_6 = Surface(<surface referenced from the Rhino model>)
# Change the number of layer with boolean
# in the dispatch pattern
contour_7 = Contour(Shape=brep_6, Point=Point(0, 0, 0), Direction=Vector(0, 0, 1), Distance=Slider(0.65, range=0..1))
dispatch_9 = Dispatch(List=flatten(contour_7), DispatchPattern=[True, True, True, False])  # -> ListA, ListB
panel_21 = Panel(dispatch_9.ListB)
divide_curve_8 = DivideCurve(Curve=dispatch_9.ListB, Count=Slider(53, range=0..100), Kinks=False)  # -> Points, Tangents, Parameters
panel_22 = Panel(dispatch_9.ListA)
divide_curve_9 = DivideCurve(Curve=dispatch_9.ListA, Count=Slider(44, range=0..100), Kinks=False)  # -> Points, Tangents, Parameters
dispatch_10 = Dispatch(List=divide_curve_8.Points, DispatchPattern=[True, False])  # -> ListA, ListB
polyline_8 = PolyLine(Vertices=divide_curve_9.Points, Closed=True)
brep_closest_point_6 = BrepClosestPoint(Point=dispatch_10.ListB, Brep=brep_6)  # -> Point, Normal, Distance
amplitude_5 = Amplitude(Vector=brep_closest_point_6.Normal, Amplitude=Slider(2, range=0..10))
panel_23 = Panel(dispatch_10.ListA)
panel_24 = Panel(dispatch_10.ListB)
move_6 = Move(Geometry=dispatch_10.ListB, Motion=amplitude_5)  # -> Geometry, Transform
weave_7 = Weave(Pattern=[0, 1], Stream0=dispatch_10.ListA, Stream1=move_6.Geometry, NullGaps=False)
polyline_9 = PolyLine(Vertices=weave_7, Closed=True)
weave_8 = Weave(Pattern=[0, 0, 0, 1], Stream0=flatten(polyline_8), Stream1=flatten(polyline_9), NullGaps=False)  # -> graft(Weave)
panel_25 = Panel(weave_8)

construct_point = ConstructPoint(XCoordinate=range, YCoordinate=0, ZCoordinate=0)
explode_2 = Explode(Curve=polyline_7, Recursive=True)  # -> Segments, Vertices
end_points = EndPoints(Curve=explode.Segments)  # -> Start, End
remap_numbers_2 = RemapNumbers(Value=curve_closest_point_2.Distance, Source=bounds_2, Target="(0 to 3)")  # -> Mapped, Clipped
panel_26 = Panel(dispatch_8.ListB)
polyline_10 = PolyLine(Vertices=flatten(merge), Closed=False)
iso_curve = IsoCurve(Surface=reparameterize(geometry), UVPoint=construct_point)  # -> UIsocurve, VIsocurve
surface_7 = Surface(<surface referenced from the Rhino model>)
contour_8 = Contour(Shape=surface_7, Point=Point(0, 0, 0), Direction=Vector(0, 0, 1), Distance=number_slider_14)
dispatch_11 = Dispatch(List=flatten(contour_8), DispatchPattern=[True, False])  # -> ListA, ListB
divide_curve_10 = DivideCurve(Curve=dispatch_11.ListB, Count=10, Kinks=False)  # -> Points, Tangents, Parameters
divide_curve_11 = DivideCurve(Curve=dispatch_8.ListB, Count=Slider(51, range=0..100), Kinks=False)  # -> Points, Tangents, Parameters
vector_2pt = Vector2Pt(PointA=end_points.Start, PointB=end_points.End, Unitize=False)  # -> Vector, Length
end_points_2 = EndPoints(Curve=explode_2.Segments)  # -> Start, End
range_2 = Range(Domain=Domain(0, 1), Steps=expr("x-1", number_slider_4))
construct_point_2 = ConstructPoint(XCoordinate=0, YCoordinate=0, ZCoordinate=0)
panel_27 = Panel(dispatch_8.ListA)
flip_matrix_3 = FlipMatrix(Data=vector_2pt.Vector)
vector_2pt_2 = Vector2Pt(PointA=end_points_2.Start, PointB=end_points_2.End, Unitize=False)  # -> Vector, Length
divide_curve_12 = DivideCurve(Curve=dispatch_8.ListA, Count=Slider(44, range=0..100), Kinks=False)  # -> Points, Tangents, Parameters
dispatch_12 = Dispatch(List=divide_curve_11.Points, DispatchPattern=[True, False])  # -> ListA, ListB
range_3 = Range(Domain=Domain(0, 1), Steps=expr("x-1", list_length))
cull_index_2 = CullIndex(List=iso_curve.VIsocurve, Indices=Slider(0, range=0..100), Wrap=True)
number_slider_15 = Slider(3, range=0..10)
number_slider_16 = Slider(10, range=0..10)
multiplication = Multiplication(A=flip_matrix_3, B=range_2)
number_slider_17 = Slider(30, range=0..100)
polyline_11 = PolyLine(Vertices=divide_curve_12.Points, Closed=True)
brep_closest_point_7 = BrepClosestPoint(Brep=surface_5)  # -> Point, Normal, Distance
divide_surface = DivideSurface(Surface=surface_5, UCount=Slider(3, range=0..10), VCount=10)  # -> Points, Normals, Parameters
curve_closest_point_3 = CurveClosestPoint()  # -> Point, Parameter, Distance
divide_surface_2 = DivideSurface(Surface=surface_7, UCount=Slider(50, range=0..100), VCount=Slider(20, range=0..100))  # -> flatten(Points), Normals, Parameters
surface_closest_point = SurfaceClosestPoint(Point=construct_point_2, Surface=reparameterize(surface_7))  # -> Point, UVPoint, Distance
surface_closest_point_2 = SurfaceClosestPoint(Point=dispatch_12.ListB, Surface=surface_5)  # -> Point, UVPoint, Distance
flip_matrix_4 = FlipMatrix(Data=vector_2pt_2.Vector)
panel_28 = Panel(divide_surface_2.Points)
move_7 = Move(Geometry=divide_curve_7.Points, Motion=multiplication)  # -> Geometry, Transform
unit_x = UnitX(Factor=1)
multiplication_2 = Multiplication(A=flip_matrix_4, B=range_3)
surface_8 = Surface()
panel_29 = Panel(dispatch_12.ListA)
image_sampler = ImageSampler(surface_closest_point.UVPoint, Filter="Value", Interpolate=False, Umax=375, Umin=1, Vmax=360, Vmin=1, Wrap=1)
# Weave
# Length 50mm in x direction
# height 20mm in z direction
# layer height 1mm
surface_9 = Surface(<surface referenced from the Rhino model>)
unit_z_2 = UnitZ(Factor=1)
image_sampler_2 = ImageSampler(surface_closest_point_2.UVPoint, Filter="Value", Interpolate=False, Umax=375, Umin=1, Vmax=360, Vmin=1, Wrap=1)
move_8 = Move(Geometry=cull_index, Motion=multiplication_2)  # -> Geometry, Transform
bounds_3 = Bounds(Numbers=surface_closest_point_2.Distance)
polyline_12 = PolyLine(Vertices=flatten(move_7.Geometry), Closed=False)
panel_30 = Panel(dispatch_12.ListB)
panel_31 = Panel(image_sampler)
contour_9 = Contour(Shape=surface_8, Point=Point(0, 0, 0), Direction=Vector(0, 0, 1), Distance=Slider(1, range=0..1))
contour_10 = Contour(Shape=surface_9, Point=Point(0, 0, 0), Direction=Vector(0, 0, 1), Distance=Slider(1.7, range=0..10))
remap_numbers_3 = RemapNumbers(Value=image_sampler_2, Source=bounds_3, Target="(0 to 1)")  # -> Mapped, Clipped
polyline_13 = PolyLine(Vertices=flatten(move_8.Geometry), Closed=False)
unit_z_3 = UnitZ(Factor=image_sampler_2)
amplitude_6 = Amplitude(Vector=unit_z_3, Amplitude=Slider(2, range=0..10))
panel_32 = Panel(image_sampler_2)
move_9 = Move(Geometry=surface_closest_point_2.UVPoint, Motion=amplitude_6)  # -> Geometry, Transform
weave_9 = Weave(Pattern=[0, 1], Stream0=dispatch_12.ListA, Stream1=move_9.Geometry, NullGaps=False)
dispatch_13 = Dispatch(List=flatten(contour_10), DispatchPattern=[True, False])  # -> ListA, ListB
divide_curve_13 = DivideCurve(Curve=contour_9, Count=10, Kinks=False)  # -> Points, Tangents, Parameters
line_sdl = LineSDL(Start=divide_surface_2.Points, Direction=[unit_x, unit_z_2], Length=panel_31)
panel_33 = Panel(remap_numbers_3.Mapped)
polyline_14 = PolyLine(Vertices=weave_9, Closed=True)
divide_curve_14 = DivideCurve(Curve=dispatch_13.ListB, Count=Slider(59, range=0..100), Kinks=False)  # -> Points, Tangents, Parameters
brep_closest_point_8 = BrepClosestPoint(Point=divide_curve_13.Points, Brep=surface_8)  # -> Point, Normal, Distance
multiplication_3 = Multiplication(A=image_sampler_2, B=Slider(0, range=0..1000))
unit_x_2 = UnitX(Factor=multiplication_3)
unit_y = UnitY(Factor=multiplication_3)
unit_y_2 = UnitY(Factor=1)
bounds_4 = Bounds()
dispatch_14 = Dispatch(List=divide_curve_14.Points, DispatchPattern=[True, False])  # -> ListA, ListB
weave_10 = Weave(Pattern=[0, 0, 0, 1], Stream0=flatten(polyline_11), Stream1=flatten(polyline_14), NullGaps=False)  # -> graft(Weave)
move_10 = Move(Geometry=dispatch_14.ListB, Motion=unit_y_2)  # -> Geometry, Transform
remap_numbers_4 = RemapNumbers(Source=bounds_4, Target="(0 to 3)")  # -> Mapped, Clipped
weave_11 = Weave(Pattern=[0, 1], NullGaps=False)
weave_12 = Weave(Pattern=[0, 1], Stream0=dispatch_14.ListA, Stream1=move_10.Geometry, NullGaps=False)
amplitude_7 = Amplitude(Vector=brep_closest_point_8.Normal, Amplitude=Slider(50, range=0..100))
polyline_15 = PolyLine(Vertices=weave_11, Closed=True)
brep_7 = Brep(<brep referenced from the Rhino model>)
number_slider_18 = Slider(50, range=0..100)
# Application
mesh = Mesh(<mesh referenced from the Rhino model>)
polyline_16 = PolyLine(Vertices=weave_12, Closed=False)
contour_11 = Contour(Shape=brep_7, Point=Point(0, 0, 0), Direction=Vector(0, 0, 1), Distance=Slider(4, range=0..10))
vector_display_ex_3 = VectorDisplayEx(Point=brep_closest_point_8.Point, Vector=amplitude_7, Colour=RGB(0, 0, 0), Width=2)
weave_13 = Weave(Pattern=[0, 1], Stream0=dispatch_13.ListA, Stream1=flatten(polyline_16), NullGaps=False)
contour_12 = Contour(Shape=mesh, Point=Point(0, 0, 0), Direction=Vector(0, 0, 1), Distance=Slider(4, range=0..10))  # -> flatten(Contours)
explode_3 = Explode(Curve=weave_3, Recursive=True)  # -> Segments, Vertices
# to g-code
control_points_2 = ControlPoints(Curve=weave_3)  # -> Points, Weights, Knots
curve_4 = Curve([<curve referenced from the Rhino model> x47])
weave_14 = Weave(Pattern=[0, 0, 0, 1], Stream1=flatten(polyline_15), NullGaps=False)  # -> graft(Weave)
divide_curve_15 = DivideCurve(Curve=contour_11, Count=number_slider_18, Kinks=False)  # -> Points, Tangents, Parameters
number_slider_19 = Slider(0, range=0..100)
panel_34 = Panel(explode_3.Segments)
panel_35 = Panel(contour_12)
number_slider_20 = Slider(0.005, range=0..0.01)
number_slider_21 = Slider(0.0075, range=0..0.01)
panel_36 = Panel(control_points_2.Points)
number_slider_22 = Slider(0.013, range=0..0.1)
dispatch_15 = Dispatch(List=contour_12, DispatchPattern=[True, False])  # -> ListA, ListB
length = Length(Curve=explode_3.Segments)
flip_matrix_5 = FlipMatrix(Data=divide_curve_15.Points)
dispatch_16 = Dispatch(List=flatten(curve_4), DispatchPattern=[True, False])  # -> ListA, ListB
number_slider_23 = Slider(0.1, range=0..1)
polyline_17 = PolyLine(Vertices=flip_matrix_5, Closed=False)
insert_items = InsertItems(List=flatten(length), Item=number_slider_19, Indices=number_slider_19, Wrap=True)
number_slider_24 = Slider(0.015, range=0..0.1)
panel_37 = Panel(dispatch_15.ListA)
number_slider_25 = Slider(0.02, range=0..0.1)
flip_curve_2 = FlipCurve(Curve=dispatch_16.ListB)  # -> Curve, Flag
flip_curve_3 = FlipCurve(Curve=dispatch_15.ListA)  # -> Curve, Flag
deconstruct_3 = Deconstruct(Point=flatten(panel_36))  # -> XComponent, YComponent, ZComponent
multiplication_4 = Multiplication(A=insert_items, B=Slider(0.01, range=0..0.01))
number_slider_26 = Slider(0.015, range=0..0.1)
explode_4 = Explode(Curve=polyline_17, Recursive=True)  # -> Segments, Vertices
mass_addition = MassAddition(Input=flatten(multiplication_4))  # -> Result, PartialResults
weave_15 = Weave(Pattern=[0, 1], Stream0=dispatch_16.ListA, Stream1=flip_curve_2.Curve, NullGaps=False)
curve_to_polyline = CurveToPolyline(Curve=weave_15, ToleranceDistance=Slider(0.05, range=0..0.1), ToleranceAngle=0)  # -> flatten(Polyline), Segments
number_slider_27 = Slider(30, range=0..100)
weave_16 = Weave(Pattern=[0, 1], Stream0=flip_curve_3.Curve, Stream1=dispatch_15.ListB, NullGaps=False)
panel_38 = Panel(multiplication_4)
end_points_3 = EndPoints(Curve=explode_4.Segments)  # -> Start, End
multiplication_5 = Multiplication(A=Slider(30, range=0..100), B=Slider(60, range=0..100))
explode_5 = Explode(Curve=curve_to_polyline.Polyline, Recursive=True)  # -> flatten(Segments), Vertices
# to g-code
control_points_3 = ControlPoints(Curve=curve_to_polyline.Polyline)  # -> flatten(Points), Weights, Knots
panel_39 = Panel(mass_addition.PartialResults)
control_points_4 = ControlPoints(Curve=weave_16)  # -> Points, Weights, Knots
vector_2pt_3 = Vector2Pt(PointA=end_points_3.Start, PointB=end_points_3.End, Unitize=False)  # -> Vector, Length
number_slider_28 = Slider(0, range=0..100)
number_slider_29 = Slider(0.013, range=0..0.1)
panel_40 = Panel(explode_5.Segments)
panel_41 = Panel(control_points_3.Points)
range_4 = Range(Domain=Domain(0, 1), Steps=expr("x-1", number_slider_18))
number_slider_30 = Slider(0.01, range=0..0.01)
length_2 = Length(Curve=explode_5.Segments)
number_slider_31 = Slider(0.005, range=0..0.01)
concatenate = Concatenate(
    FragmentH="G1 ",
    FragmentG="F",
    FragmentK=multiplication_5,
    FragmentA=" X",
    FragmentB=deconstruct_3.XComponent,
    FragmentC=" Y",
    FragmentD=deconstruct_3.YComponent,
    FragmentE=" Z",
    FragmentF=deconstruct_3.ZComponent,
    FragmentI=" E",
    FragmentJ=panel_39)
polyline_18 = PolyLine(Vertices=control_points_4.Points, Closed=False)
flip_matrix_6 = FlipMatrix(Data=vector_2pt_3.Vector)
insert_items_2 = InsertItems(List=flatten(length_2), Item=number_slider_28, Indices=number_slider_28, Wrap=True)
panel_42 = Panel(concatenate)
number_slider_32 = Slider(0.015, range=0..0.1)
panel_43 = Panel("""G90 
M82
G28
G92 E0.0000
G1 E-4.0000 F6000""")
panel_44 = Panel("""G92 E0.0000
G1 Z30 E-4.0000 F6000
G28""")
number_slider_33 = Slider(0.02, range=0..0.1)
panel_45 = Panel(polyline_18)
deconstruct_4 = Deconstruct(Point=flatten(panel_41))  # -> XComponent, YComponent, ZComponent
multiplication_6 = Multiplication(A=insert_items_2, B=Slider(0.0075, range=0..0.01))
number_slider_34 = Slider(0.015, range=0..0.1)
mass_addition_2 = MassAddition(Input=flatten(multiplication_6))  # -> Result, PartialResults
panel_46 = Panel(multiplication_6)
multiplication_7 = Multiplication(A=flip_matrix_6, B=range_4)
merge_2 = Merge(Data1=flatten(panel_43), Data2=flatten(concatenate), Data3=flatten(panel_44))
multiplication_8 = Multiplication(A=Slider(30, range=0..100), B=Slider(60, range=0..100))
move_11 = Move(Geometry=divide_curve_15.Points, Motion=multiplication_7)  # -> Geometry, Transform
panel_47 = Panel(mass_addition_2.PartialResults)
panel_48 = Panel(merge_2)
concatenate_2 = Concatenate(
    FragmentH="G1 ",
    FragmentG="F",
    FragmentK=multiplication_8,
    FragmentA=" X",
    FragmentB=deconstruct_4.XComponent,
    FragmentC=" Y",
    FragmentD=deconstruct_4.YComponent,
    FragmentE=" Z",
    FragmentF=deconstruct_4.ZComponent,
    FragmentI=" E",
    FragmentJ=panel_47)
polyline_19 = PolyLine(Vertices=flatten(move_11.Geometry), Closed=False)
panel_49 = Panel(concatenate_2)
panel_50 = Panel("""G92 E0.0000
G1 Z25 E-4.0000 F6000
G28""")
panel_51 = Panel("""G90 
M82
G28
G92 E0.0000
G1 E-4.0000 F6000""")
panel_52 = Panel(polyline_19)
merge_3 = Merge(Data1=flatten(panel_51), Data2=flatten(concatenate_2), Data3=flatten(panel_50))
panel_53 = Panel(merge_3)
